# Grasshopper definition blocksfab.gh (Grasshopper 1.0.7)
# plug-ins: Pufferfish, MeshEdit Components

mesh = Mesh(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)
face_boundaries = FaceBoundaries(Mesh=mesh)
control_polygon = ControlPolygon(Curve=face_boundaries)  # -> Polygon, Points
list_item = ListItem(List=control_polygon.Points, Index=0, Wrap=True)  # -> Item, Item1, Item2
incircle = InCircle(CornerA=list_item.Item, CornerB=list_item.Item1, CornerC=list_item.Item2)  # -> Circle, Plane, Radius
plane_offset = PlaneOffset(BasePlane=incircle.Plane, Offset="-0.1")
plane_offset_2 = PlaneOffset(BasePlane=incircle.Plane, Offset="0.1")
deconstruct_plane = DeconstructPlane(Plane=flatten(plane_offset))  # -> Origin, XAxis, YAxis, ZAxis
deconstruct_plane_2 = DeconstructPlane(Plane=flatten(plane_offset_2))  # -> Origin, XAxis, YAxis, ZAxis
deconstruct_plane_3 = DeconstructPlane(Plane=flatten(incircle.Plane))  # -> Origin, XAxis, YAxis, ZAxis
c_script = CSharpScript(
    mesh=mesh,
    ct=deconstruct_plane.Origin,
    Reference=["C:\Users\yangw\AppData\Roaming\Grasshopper\Libraries\Plankton.dll", "C:\Users\yangw\AppData\Roaming\Grasshopper\Libraries\PlanktonGh.dll"])  # -> out, planktonMesh, averagePlane, faceVIndices, adjFaceIndices, vertices, thicknessDomains; inputs mesh: Mesh, ct: list of Point3d
# ---------- c_script: C# usings ----------
using Plankton;
using PlanktonGh;
# ---------- c_script: C# ----------
    var dual = mesh.ToPlanktonMesh().Dual();
    dual.ReplaceVertices(ct);


    List<Plane> pls = new List<Plane>();
    List<Interval> domains = new List<Interval>();
    DataTree<int> adjf_indices = new DataTree<int>();
    DataTree<int> pts_indices = new DataTree<int>();

    Point3d[] vts = new Point3d[dual.Vertices.Count];
    for(int i = 0;i < dual.Vertices.Count;i++)
    {
      vts[i] = dual.Vertices[i].ToPoint3d();
    }

    for(int i = 0;i < dual.Faces.Count;i++)
    {
      Plane pl;
      Point3d pA = new Point3d();
      Interval dom = new Interval(double.MaxValue, double.MinValue);
      List<Point3d> pts = new List<Point3d>();
      int count = 0;
      foreach(int he_index in dual.Faces.GetHalfedgesCirculator(i))
      {
        Point3d pt = dual.Vertices[dual.Halfedges[he_index].StartVertex].ToPoint3d();
        pts.Add(pt); pA += pt;
        pts_indices.Add(dual.Halfedges[he_index].StartVertex, new GH_Path(i));
        adjf_indices.Add(dual.Halfedges[dual.Halfedges.GetPairHalfedge(he_index)].AdjacentFace, new GH_Path(i));
        count++;
      }
      pA /= count;
      Plane.FitPlaneToPoints(pts, out pl);
      pl.Origin = pA;

      Vector3d vA = Vector3d.Zero;
      for(int k = 0;k < pts.Count;k++)
      {
        Point3d rpt = Point3d.Origin;
        pl.RemapToPlaneSpace(pts[k], out rpt);
        dom.T1 = dom.T1 > rpt.Z ? dom.T1 : rpt.Z;
        dom.T0 = dom.T0 < rpt.Z ? dom.T0 : rpt.Z;
        dom.T1 = dom.T1 > 0.05 ? dom.T1 : 0.05;
        dom.T0 = dom.T0 < -0.05 ? dom.T0 : -0.05;
        vA += Vector3d.CrossProduct(pts[k] - pA, pts[k < (pts.Count - 1) ? (k + 1) : 0] - pA);
      }
      vA.Unitize();
      if (vA * pl.ZAxis < 0)
      {
        pl.Flip();dom.T1 = 0 - dom.T0;dom.T0 = 0 - dom.T1;
      }
      pls.Add(pl);
      domains.Add(dom);
    }

    planktonMesh = dual;
    averagePlane = pls;
    faceVIndices = pts_indices;
    adjFaceIndices = adjf_indices;
    vertices = vts;
    thicknessDomains = domains;
# ---------- end c_script ----------
c_script_2 = CSharpScript(
    mesh=mesh,
    ct=deconstruct_plane_2.Origin,
    Reference=["C:\Users\yangw\AppData\Roaming\Grasshopper\Libraries\Plankton.dll", "C:\Users\yangw\AppData\Roaming\Grasshopper\Libraries\PlanktonGh.dll"])  # -> out, planktonMesh, averagePlane, faceVIndices, adjFaceIndices, vertices, thicknessDomains; inputs mesh: Mesh, ct: list of Point3d; same code as c_script
c_script_3 = CSharpScript(
    mesh=mesh,
    ct=deconstruct_plane_3.Origin,
    Reference=["C:\Users\yangw\AppData\Roaming\Grasshopper\Libraries\Plankton.dll", "C:\Users\yangw\AppData\Roaming\Grasshopper\Libraries\PlanktonGh.dll"])  # -> out, planktonMesh, averagePlane, faceVIndices, adjFaceIndices, vertices, thicknessDomains; inputs mesh: Mesh, ct: list of Point3d; same code as c_script
deconstruct_domain = DeconstructDomain(Domain=c_script_3.thicknessDomains)  # -> Start, End
list_item_2 = ListItem(List=c_script.vertices, Index=c_script.faceVIndices, Wrap=True)
list_item_3 = ListItem(List=c_script_2.vertices, Index=c_script_2.faceVIndices, Wrap=True)
merge = Merge(Data1=graft(deconstruct_domain.Start), Data2=graft(deconstruct_domain.End))
plane_offset_3 = PlaneOffset(BasePlane=graft(c_script_3.averagePlane), Offset=merge)
plane = Plane(simplify(plane_offset_3))
list_item_4 = ListItem(List=plane, Index=0, Wrap=True)  # -> Item, Item1
flip_plane = FlipPlane(Plane=list_item_4.Item1, FlipX=False, FlipY=False, FlipZ=True)  # -> Flipped, ResultBoolean
polyline = PolyLine(Vertices=list_item_2, Closed=invert(False))
polyline_2 = PolyLine(Vertices=list_item_3, Closed=invert(False))
explode = Explode(Curve=polyline, Recursive=True)  # -> Segments, Vertices
explode_2 = Explode(Curve=polyline_2, Recursive=True)  # -> Segments, Vertices
control_polygon_2 = ControlPolygon(Curve=explode.Segments)  # -> Polygon, Points
control_polygon_3 = ControlPolygon(Curve=explode_2.Segments)  # -> Polygon, Points
list_item_5 = ListItem(List=control_polygon_2.Points, Index=0, Wrap=True)  # -> Item, Item1
list_item_6 = ListItem(List=control_polygon_3.Points, Index=0, Wrap=True)  # -> Item, Item1
merge_2 = Merge(Data1=control_polygon_2.Points, Data2=control_polygon_3.Points)
average = Average(Input=merge_2)
vector_2pt = Vector2Pt(PointA=list_item_5.Item, PointB=list_item_5.Item1, Unitize=False)  # -> Vector, Length
vector_2pt_2 = Vector2Pt(PointA=list_item_5.Item, PointB=list_item_6.Item, Unitize=False)  # -> Vector, Length
construct_plane = ConstructPlane(Origin=average, XAxis=vector_2pt_2.Vector, YAxis=vector_2pt.Vector)
deconstruct = Deconstruct(Point=flatten(list_item_4.Item1))  # -> XComponent, YComponent, ZComponent
shift_paths = ShiftPaths(Data=construct_plane, Offset=-1)
plane_2 = Plane(simplify(shift_paths))
plane_region = PlaneRegion(Plane=list_item_4.Item, Bounds=plane_2)
plane_region_2 = PlaneRegion(Plane=flip_plane.Flipped, Bounds=plane_2)
merge_3 = Merge(Data1=plane_region, Data2=plane_region_2)
control_polygon_4 = ControlPolygon(Curve=merge_3)  # -> Polygon, Points
shift_list = ShiftList(List=control_polygon_4.Points, Shift=1, Wrap=invert(True))
shift_paths_2 = ShiftPaths(Data=simplify(shift_list), Offset=-1)
_3d_convexhull = _3DConvexHull(Points=shift_paths_2)
rebuild_mesh = RebuildMesh(
    Mesh=_3d_convexhull,
    RebuildNormals=False,
    CullUnused=invert(False),
    UnifyNormals=False,
    FlipNormals=False,
    IdenticalCombine=invert(False),
    WeldVertices=0)
reparameterize_numbers = ReparameterizeNumbers(Numbers=deconstruct.ZComponent, Invert=False)  # -> Reparameterized, Original
unweld_mesh = UnweldMesh(Mesh=rebuild_mesh, Angle=degrees(1))  # -> flatten(Result)
gradient = Gradient(
    LowerLimit=Slider(0, range=0..1),
    UpperLimit=1,
    Parameter=reparameterize_numbers.Reparameterized,
    stops=[0: RGB(214, 188, 133), 0.85: RGB(122, 10, 10)])
create_material = CreateMaterial(Diffuse=gradient, Specular=RGB(255, 255, 255), Emission=RGB(0, 0, 0), Transparency=0, Shine=0)
custom_preview = CustomPreview(Geometry=unweld_mesh, Material=create_material)
